# Grasshopper definition 00_UR_basicSettings.ghx (Grasshopper 1.0.7)

reset_parameters = Button()

# ----
# Fabrication Parameters
vel_in_mm_s = Slider(60, range=0..100)
accel = Slider(0.05, range=0..0.1)
division = Division(A=vel_in_mm_s, B="1000")

# ----
# Slice List
max_drop_counts = Panel("299")
slice_length = Slider(250, range=0..500)

panel = Panel(division)
python = GhPythonScript(vel=division, accel=accel, max_drops=max_drop_counts, slice_length=slice_length, reset=reset_parameters)  # -> visualization, way_plane_nlist, vel_nlist, accel_nlist; inputs way_plane_nlist: list, max_drops: Int32, slice_length: Int32, reset: Boolean
# ---------- python: Python ----------
import Rhino.Geometry as rg
import ghpythonlib.components as ghc
import ghpythonlib.treehelpers as th
from compas_ghpython import ghtree_to_list, list_to_ghtree 
from scriptcontext import sticky as drop_params

from compas_rhino import unload_modules
unload_modules('data_structure')
import data_structure as ds

if reset:
    drop_params.clear()
else:
    drop_params['planes'] = way_plane_nlist
    drop_params['velocities'] = ds.duplicate_data(way_plane_nlist, vel)
    drop_params['accelerations'] = ds.duplicate_data(way_plane_nlist, accel)
    drop_params['constant_velocity'] = vel
    drop_params['constant_acceleration'] = accel
    drop_params['ed_x'] = ed_x
    drop_params['ed_y'] = ed_y
    drop_params['ed_z'] = ed_z


all_planes = ds.flatten_nlist(drop_params['planes'])

if len(all_planes) <= max_drops:
    for key, items in drop_params.items():
        way_plane_nlist     = drop_params['planes']
        vel_nlist           = drop_params['velocities'] 
        accel_nlist         = drop_params['accelerations']
else:
    for key, items in drop_params.items():
        if key == 'planes':
            way_plane_nlist = ds.rearrange_nlist(items, slice_length)
        elif key == 'velocities':
            vel_nlist = ds.rearrange_nlist(items, slice_length)
        elif key == 'accelerations':
            accel_nlist = ds.rearrange_nlist(items, slice_length)
        elif key == 'waits':


"""
Check whether all data lengths are equal
"""

for i in range(len(way_plane_nlist)):
    if len(way_plane_nlist[i]) == len(vel_nlist[i]) == len(accel_nlist[i]) == len(wait_nlist[i]) == len(drop_distance_nlist[i]):
        print ('ok', 'length : ', len(way_plane_nlist[i]))
    else:
        print ('data len doesnt match :', i)

"""Visualization in GH"""
visualization = list_to_ghtree (way_plane_nlist)
# ---------- end python ----------

# ----
# Fabricating :)
send_pre_dropping = Button()
send_dropping = Button()
predrop_count = Slider(8, range=0..100)

# ----
# Modify it when data needs to be sliced
l_index = Slider(0, range=0..100)

# ----
# Generate script
dropping = GhPythonScript(l_index=l_index, preDrop_count=predrop_count)  # -> script_D; inputs way_plane_nlist: list, vel_nlist: list, accel_nlist: list, drop_distance_nlist: list, l_index: Int32, preDrop_count: Int32
# ---------- dropping: Python ----------
import ghpythonlib.components as ghc
import ghpythonlib.treehelpers as th
from compas_ghpython import ghtree_to_list, list_to_ghtree 
import Rhino.Geometry as rg
import math as m

from compas_rhino import unload_modules
unload_modules('simple_ur_script')
unload_modules('simple_comm')
unload_modules('sticky')
import simple_comm as c
import simple_ur_script as ur
from scriptcontext import sticky as drop_params

velocity = drop_params['constant_velocity']
acceleration = drop_params['constant_acceleration']
ed_x = drop_params['ed_x']
ed_y = drop_params['ed_y']
ed_z = drop_params['ed_z']


script = ""
script += ur.textmsg("Current plane index: ",l_index )
script += ur.set_tcp_by_angles(ed_x*-1, ed_z + drop_dis, ed_y, m.radians(91.0), m.radians(0.0), m.radians(0.0))
script += ur.set_digital_out(2, True)#Activate Fan

#   Move to pre drop location
script += ur.move_j([m.radians(109.10),m.radians(-209.66),m.radians(-74.08),m.radians(-75.23),m.radians(-70.9),m.radians(-180)], acceleration, velocity)

for i, (wp_list, vel_list, accel_list) in enumerate(zip(way_plane_nlist, material_nlist, vel_nlist, accel_nlist)):
    for j,(wp, material, vel, accel) in enumerate(zip(wp_list, vel_list, accel_list)):
        script += "    "+ ur.move_l(wp, accel, vel)

script_D = c.concatenate_script("def drop():",script)
# ---------- end dropping ----------

# ----
# Send to UR
send_to_ur = GhPythonScript(script_D=dropping, send_dropping=send_dropping)  # inputs send_dropping: Boolean
# ---------- send_to_ur: Python ----------
from compas_rhino import unload_modules
unload_modules('simple_comm')
import simple_comm as c


if send_dropping:
    c.send_script(script_D, "192.168.10.10")
# ---------- end send_to_ur ----------

brep = Brep(<brep referenced from the Rhino model>)
brep_2 = Brep(<brep referenced from the Rhino model>)

layer_height = Slider(5, range=0.5..10)
offset_distance = Slider(2.2, range=0.5..50)
thickness_layer = Slider(3, range=1..10)
seg_length = Slider(2.9, range=0.1..10)

velocity = Slider(15, range=0..50)
acceleration = Slider(5, range=0..50)

pt = ConstructPoint(XCoordinate="624", YCoordinate="-160", ZCoordinate="-137.5")
pt_2 = ConstructPoint(XCoordinate="574", YCoordinate="-160", ZCoordinate="-137.5")
pt_3 = ConstructPoint(XCoordinate="574", YCoordinate="140", ZCoordinate="-137.5")
pt_4 = ConstructPoint(XCoordinate="624", YCoordinate="140", ZCoordinate="-137.5")

pt_5 = ConstructPoint(XCoordinate="612", YCoordinate="-180", ZCoordinate="-30")

# ----
# Joint angles of robot safety position
robot_joint_angles = Panel("""-180.00
-109.78
150.91
-131.22
-90.00
180.00""")

contour = GhPythonScript(brep=brep, layer_height=layer_height, offset_distance=offset_distance, thickness_layer=thickness_layer)  # -> vis_contourCrvs, contourCrv_nList; inputs brep: Brep, thickness_layer: Int32
# ---------- contour: Python ----------
__author__ = "Fen"
import Rhino.Geometry as rg
import ghpythonlib.components as ghc
import ghpythonlib.treehelpers as th
from compas_ghpython import ghtree_to_list, list_to_ghtree 
"-------Import Library-------"
from compas_rhino import unload_modules
unload_modules('e2e_pathSlicer')
import e2e_pathSlicer as ps
"-------------------------------------"

# get contour curves from a brep
contourCrvs,_= ps.contour(brep, rg.Point3d(0,0,0),layer_height)


contourCrv_nList =[]

if thickness_layer==1:
    contourCrv_nList = [[crv] for crv in contourCrvs]
elif thickness_layer !=1:
    for i,crv in enumerate(contourCrvs):
        crvs = []
        for j in range(thickness_layer):
            if j ==0:
                crvs.append(crv)
            else:
                offset_crv = rg.Curve.Offset(crv, rg.Plane.WorldXY, offset_distance*j, 0.01, rg.CurveOffsetCornerStyle.Sharp)
                print type(*offset_crv)
#                polycrv = offset_crv[0]
#                polycrv.ToPolyline()
                crvs.append(*offset_crv)
        contourCrv_nList.append(crvs)

vis_contourCrvs = list_to_ghtree(contourCrv_nList)
# ---------- end contour ----------
crv = Curve(contour.vis_contourCrvs)
merge = Merge(Data1=pt, Data2=pt_4, Data3=pt_3, Data4=pt_2, Data5=pt)
pline = PolyLine(Vertices=merge, Closed=False)
dividecrvs = GhPythonScript(contourCrv_nList=contour.contourCrv_nList, seg_length=seg_length)  # -> vis_wayPoints, wayPoint_nList; inputs contourCrv_nList: list
# ---------- dividecrvs: Python ----------
__author__ = "Fen"
import Rhino.Geometry as rg
import ghpythonlib.components as ghc
import ghpythonlib.treehelpers as th
from compas_ghpython import ghtree_to_list, list_to_ghtree 
from scriptcontext import sticky
"-------Import Personal Library-------"
from compas_rhino import unload_modules
unload_modules('e2e_pathSlicer')
import e2e_pathSlicer as ps
"-------------------------------------"

"""
check if there's only a single path on each layer, 
if not, reverse every second layer
"""
check = [crv for list in contourCrv_nList for crv in list]
if len(contourCrv_nList) == len(check):
    pass
else:
    for i,layer in enumerate(contourCrv_nList):
        if i%2==1:
            layer.reverse()

"""
creat robot waypoints
"""
wayPoint_nList=[]
for crvs in contourCrv_nList:
    wayPoints = []
    for crv in crvs:
        if crv.Degree ==1:
            crv_segs = crv.DuplicateSegments()
            for i,seg in enumerate(crv_segs):
                if i !=len(crv_segs)-1:
                    wayPoints.append(seg.PointAtStart)
                else:
                    wayPoints.append(seg.PointAtStart)
                    wayPoints.append(seg.PointAtEnd)
        elif crv.Degree !=1:
            pts,_ = ps.divide_crv(crv, seg_length, True)
            wayPoints.extend(pts)
    wayPoint_nList.append(wayPoints)



print len(wayPoint_nList)

vis_wayPoints = list_to_ghtree(wayPoint_nList)
# ---------- end dividecrvs ----------
python_2 = GhPythonScript(wayPoint_nList=dividecrvs.wayPoint_nList, velocity=velocity, acceleration=acceleration)  # -> wayPlane_nList, vel_nList, accel_nList, blend_nList, extr_nList; inputs wayPoint_nList: list
# ---------- python_2: Python ----------
__author__ = "Fen"
import Rhino.Geometry as rg
import ghpythonlib.components as ghc
import ghpythonlib.treehelpers as th
from compas_ghpython import ghtree_to_list, list_to_ghtree 
from scriptcontext import sticky
"-------Import Personal Library-------"
from compas_rhino import unload_modules
unload_modules('e2e_pathSlicer')
import e2e_pathSlicer as ps
"-------------------------------------"

velocity = velocity/1000
acceleration = acceleration/1000
print velocity

"""Here we create robot way planes"""
wayPlane_nList = []
for pts in wayPoint_nList:
    planes = [rg.Plane(pt, rg.Vector3d.ZAxis) for pt in pts]
    wayPlane_nList.append(planes)

"""Here we create other parameters for robot"""
vel_nList =[]
accel_nList =[]
blend_nList =[]
extr_nList =[]
for pts in wayPoint_nList:
    vels = []
    accels = []
    blends = ps.calc_blendRadius(pts, buffer=0.1)
    extrs = []
    for pt in pts:
        vels.append(velocity)
        accels.append(acceleration)
        extrs.append(True)
    vel_nList.append(vels)
    accel_nList.append(accels)
    blend_nList.append(blends)
    extr_nList.append(extrs)

#print len(vel_nList[1]),len(accel_nList[1]),len(blend_nList[1]),len(extr_nList[1])
# ---------- end python_2 ----------

# ---- group: Select Target Pt
# velocity = 0.012
# acceleration = 0.05
# blend_redious = 0.01
# layers = 50
# layer_height = 3.5
list = ValueList({"Printing Table Origin": 0, "///": 1, "////": 2}, selected="Printing Table Origin")
# velocity = 0.020
# acceleration = 0.05
# blend_redious = 0.01
# layers = 50
# layer_height = 3.5
filter = StreamFilter(Gate=list, Stream0=pt_5)

# ----
# Robot TCP Adjustment
tcp_h = Slider(0, range=0..300)

# ----
# Set robot to safety position
# BEFOR or AFTER printing.
safetyposition = Button()

# ----
# Move robot to a certain point
targetpt = Button()

# ----
# Robot IO
io = BooleanToggle(False)

# ----
# Run test print
testprint = Button()

pl = GhPythonScript(pt=filter)  # -> plane; inputs pt: Point3d
# ---------- pl: Python ----------
import Rhino.Geometry as rg

plane = rg.Plane(pt, rg.Vector3d.XAxis, rg.Vector3d.YAxis)
# ---------- end pl ----------
# velocity = 0.015
# acceleration = 0.05
# blend_redious = 0.005
# layers = 50
# layer_height = 4.0
sendtopoint = GhPythonScript(
    joints=robot_joint_angles,
    target_plane=pl,
    tcp_height=tcp_h,
    IO=io,
    send_safePos=safetyposition,
    send=targetpt,
    testPrint=testprint,
    pts=merge)  # -> out, script; inputs joints: list, target_plane: Plane, IO: Boolean, send_safePos: Boolean, testPrint: Boolean, pts: list of Point3d
# ---------- sendtopoint: Python ----------
from compas_rhino import unload_modules
unload_modules('simple_ur_script')
unload_modules('simple_comm')
import simple_comm as c
import simple_ur_script as ur
import Rhino.Geometry as rg
import math as m

#ed_x = 52.5
#ed_y = 85.5
#ed_z = 161.5

ed_x = 0
ed_y = 0
ed_z = 0

T = rg.Transform.Translation(0,0,tcp_height)
target_plane.Transform(T)

velocity = 0.015
acceleration = 0.05
blend_redious = 0.005
layers = 50
layer_height = 3.0


if send_safePos:
    script = ""
    joints = [m.radians(joints[i]) for i in range(len(joints))]
    script += ur.move_j(joints, acceleration, velocity)
    script = c.concatenate_script("def sendToSafePos():",script)
    c.send_script(script,"192.168.10.10")

elif send:
    script = ""
    script += ur.set_standard_analog_out(0,0)
    script += ur.set_tcp_by_angles(ed_x, ed_y, ed_z, m.radians(-180.0), m.radians(0.0), m.radians(-90.0))
    script += ur.move_l(target_plane, acceleration, velocity)
    

    """
    TEST
    """
    if IO:
#        script += ur.set_digital_out(0, True)#Turn on air
        script += ur.set_standard_analog_out(0,0.3)#0.3 = 3.0 Voltage                                                                                               
        script += ur.sleep(30)
        script += ur.set_standard_analog_out(0,0)
    """
    TEST
    """

    script = c.concatenate_script("def sendToPt():",script)
    c.send_script(script,"192.168.10.10")



if testPrint:
    script = ""
    script += ur.set_digital_out(0, False)#Turn off air
    script += ur.set_standard_analog_out(0,0)
    script += ur.set_tcp_by_angles(ed_x, ed_y, ed_z, m.radians(-180.0), m.radians(0.0), m.radians(-90.0))
    script += ur.move_l(target_plane, acceleration, velocity)
    for i in range(layers):
        for pt in pts:
            script += ur.move_l_blend(rg.Plane(pt+i*layer_height*rg.Vector3d.ZAxis,rg.Vector3d.ZAxis), acceleration, velocity, blend_redious)
            script += ur.set_digital_out(0, True)#Turn on air
            
            script += ur.set_standard_analog_out(0,0.3)#0.3 = 3.0 Voltage  
            
    script += ur.set_digital_out(0, False)#Turn off air
    script += ur.set_standard_analog_out(0,0.0)#0.3 = 3.0 Voltage      
    script = c.concatenate_script("def testPrint():",script)
    c.send_script(script,"192.168.10.10")
# ---------- end sendtopoint ----------
sendtopoint_2 = GhPythonScript(
    target_plane=pl,
    wayPlane_nList=python_2.wayPlane_nList,
    vel_nList=python_2.vel_nList,
    accel_nList=python_2.accel_nList,
    blend_nList=python_2.blend_nList,
    extr_nList=python_2.extr_nList,
    testPrint=testprint)  # -> out, script; inputs target_plane: Plane, wayPlane_nList: list, vel_nList: list, accel_nList: list, blend_nList: list, extr_nList: list, testPrint: Boolean
# ---------- sendtopoint_2: Python ----------
from compas_rhino import unload_modules
unload_modules('simple_ur_script')
unload_modules('simple_comm')
import simple_comm as c
import simple_ur_script as ur
import Rhino.Geometry as rg
import math as m

#ed_x = 52.5
#ed_y = 85.5
#ed_z = 161.5

ed_x = 0
ed_y = 0
ed_z = 0
tcp_height =0

T = rg.Transform.Translation(0,0,tcp_height)
target_plane.Transform(T)


if testPrint:
    script = ""
    script += ur.set_digital_out(0, False)#Turn off air
    script += ur.set_standard_analog_out(0,0)#Turn off motor
    
    script += ur.set_tcp_by_angles(ed_x, ed_y, ed_z, m.radians(-180.0), m.radians(0.0), m.radians(-90.0))
    
    #change this plane to a safe plane above the bed
    script += ur.move_l(target_plane, acceleration, velocity)
    
    for planes,vels,accels,blends,extrs in zip(wayPlane_nList,vel_nList,accel_nList,blend_nList,extr_nList):
        for plane,vel,accel,blend,extr in zip(planes,vels,accels,blends,extrs):
            script += ur.move_l_blend(plane, accel, vel, blend)
            if extr:
                script += ur.set_digital_out(0, True)#Turn on air
                script += ur.set_standard_analog_out(0,0.3)#0.3 = 3.0 Voltage

    script += ur.set_digital_out(0, False)#Turn off air
    script += ur.set_standard_analog_out(0,0)#Turn off motor
    
    #change this plane to a safe plane above the bed
    script += ur.move_l(target_plane, acceleration, velocity)
    
    script = c.concatenate_script("def testPrint():",script)
    c.send_script(script,"192.168.10.10")
# ---------- end sendtopoint_2 ----------
# velocity = 0.08
# acceleration = 0.05
# blend_redious = 0.005
# layers = 50
# layer_height = 3.0
panel_2 = Panel(sendtopoint.script)
